# Grasshopper definition pattern_generator.gh (Grasshopper 1.0.8)

# ---- group: アイソカーブの平均カーブを基準とした4面筒作成
curve = Curve(<curve referenced from the Rhino model>)
python_3_script = Python3Script(
    curve=curve,
    UV=Toggle(True),
    avgDiv=Slider(5, range=0..50),
    rot=Slider(0.48, range=0..1),
    size_cf=Slider(1.12, range=0..3),
    offset=Slider(0, range=0..100),
    offsetDir=Toggle(False),
    x_size=Slider(81, range=0..100),
    y_size=Slider(100, range=0..100),
    decrease=Slider(0.87, range=0..1.5))  # -> out, surface, interpCrv_avg, Pts, uVec, vVec, nVec, plines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; inputs avgDiv: Int32
# ---------- python_3_script: Python ----------
"""Grasshopper Script"""
import traceback
import Rhino
from Rhino.Geometry import NurbsSurface
import math
import os
import glob
import random
import copy

import Rhino.Geometry

import rhinoscriptsyntax as rs
import ghpythonlib.treehelpers as th
import scriptcontext as sc

sc.doc = Rhino.RhinoDoc.ActiveDoc

try:
    curve
    UV # UVのTrue/Falseが正しくない場合、円筒の片方の端に点が生成されない
    avgDiv # 4エッジのinterpCrvを作る際の分割数
    rot
    size_cf
    offset
    offsetDir
    x_size
    y_size
    decrease
except NameError:
    curve = None
    UV = True
    avgDiv = 5
    rot = 0
    size_cf = 1.5
    offset = 100
    offsetDir = True
    x_size = 10
    y_size = 10
    decrease = 1.0

try:
    print("hello from vscode")
    interpCrv_avg = curve
    print(interpCrv_avg)

    # 断面四角形を作成
    # UV direction
    # カーブのパラメータを取得
    Pts = []
    uVec = []
    vVec = []
    nVec = []
    t_min = interpCrv_avg.Domain[0]
    t_max = interpCrv_avg.Domain[1]
    plines = []
    lines = []
    # rot: 0から1
    # radianの0から2πに変換
    angleRad = rot * 2 * math.pi
    pt_tmp = []
    print(t_min, t_max)
    # 四角形長さ倍率の基準
    x_diff_std = 100
    y_diff_std = 100
    # zero-twisting frameの取得
    # パラメータ：t_minからt_maxまでの間で、avgDiv分割
    param_pframes = [t_min + (t_max - t_min) * i / (avgDiv-1) for i in range(avgDiv)]
    pframes = interpCrv_avg.GetPerpendicularFrames(param_pframes)
    for i in range(int(avgDiv)):
        # t = i / float(avgDiv-1) * (t_max - t_min) + t_min
        # uvn = interpCrv_avg.UVNDirectionsAt(t)
        # Pts.append(interpCrv_avg.PointAt(t))
        # # ベクトルを回転する
        # uvn[2].Rotate(angleRad, uvn[1])
        # uvn[3].Rotate(angleRad, uvn[1])
        # # print(uvn[1].Length, uvn[2].Length, uvn[3].Length) # 1
        # uVec.append(uvn[1]*100)
        # vVec.append(uvn[2]*100)
        # nVec.append(uvn[3]*100)

        # 倍率なし
        x = x_size * size_cf
        y = y_size * size_cf

        # 倍率をかけたx,yの大きさを求める
        # x = x_size * size_cf * decrease**i
        # y = y_size * size_cf * decrease**i

        # 急に細くなるver
        # x = x_size * size_cf * (1.0 - (1.0-decrease)**(min(i, 2)))
        # y = y_size * size_cf * (1.0 - (1.0-decrease)**(min(i, 2)))

        # 端だけ細くする
        if i == 0:
            x = x_size * size_cf * decrease
            y = y_size * size_cf * decrease
        if i == avgDiv-1:
            x = x_size * size_cf * decrease
            y = y_size * size_cf * decrease
        # if i == 1:
        #     x = x_size * size_cf * decrease
        #     y = y_size * size_cf * decrease
        # if i == avgDiv-2:
        #     x = x_size * size_cf * decrease
        #     y = y_size * size_cf * decrease

        # # 断面の四角形を作る
        # p0 = Pts[i] + uvn[2]*x/2 + uvn[3]*y/2
        # p1 = Pts[i] - uvn[2]*x/2 + uvn[3]*y/2
        # p2 = Pts[i] - uvn[2]*x/2 - uvn[3]*y/2
        # p3 = Pts[i] + uvn[2]*x/2 - uvn[3]*y/2

        # ねじれ無しの座標から断面を作ってみる
        frame_i = pframes[i]
        frame_x = frame_i.XAxis
        frame_y = frame_i.YAxis
        frame_z = frame_i.ZAxis
        frame_x.Rotate(angleRad, frame_z)
        frame_y.Rotate(angleRad, frame_z)
        p0 = frame_i.Origin + frame_x*x/2 + frame_y*y/2
        p1 = frame_i.Origin - frame_x*x/2 + frame_y*y/2
        p2 = frame_i.Origin - frame_x*x/2 - frame_y*y/2
        p3 = frame_i.Origin + frame_x*x/2 - frame_y*y/2
        print(frame_x)
        print(p0)

        # ポリラインで結んでみる
        # 4点を結ぶ
        # 0-1-2-3-0
        pline = Rhino.Geometry.Polyline([p0, p1, p2, p3, p0])
        plines.append(pline)
        line_idx = [[0,1], [1,2], [2,3], [3,0]]
        lines_tmp = []
        for idx in line_idx:
            lines_tmp.append(Rhino.Geometry.Line(pline[idx[0]], pline[idx[1]]))
        lines.append(lines_tmp)

    # 端にオフセットを作成
    if offset > 0:
        # オフセットの向き
        if offsetDir:
            offset = -offset
        # 0番目
        vec0_ofs = interpCrv_avg.TangentAt(interpCrv_avg.Domain[0])
        motion = Rhino.Geometry.Transform.Translation(vec0_ofs*offset)
        # 点はいらない。線だけオフセットする
        line0 = []
        for line in lines[0]:
            line_ofs = Rhino.Geometry.Line(line.From, line.To)
            line_ofs.Transform(motion)
            line0.append(line_ofs)

        # 最後
        line1 = []
        vec1_ofs = interpCrv_avg.TangentAt(interpCrv_avg.Domain[1])
        motion = Rhino.Geometry.Transform.Translation(vec1_ofs*-offset)
        for line in lines[-1]:
            line_ofs = Rhino.Geometry.Line(line.From, line.To)
            line_ofs.Transform(motion)
            line1.append(line_ofs)
    
        # リストに追加
        lines.insert(0, line0)
        lines.append(line1)

    # 4隅のinterpCrvを作成
    icrvs = []
    for i in range(4):
        ic_pts = []
        for j in range(len(lines)):
            ic_pts.append(lines[j][i].From)
        icrv = Rhino.Geometry.NurbsCurve.CreateInterpolatedCurve(ic_pts, 3, Rhino.Geometry.CurveKnotStyle.Uniform)
        icrvs.append(icrv)

    # networksrfを作成
    icrv_idx = [[0,1], [1,2], [2,3], [3,0]]
    nsrfs = []
    for i in range(4):
        lns = []
        for j in range(len(lines)):
            lns.append(lines[j][i].ToNurbsCurve())
        nsrf = Rhino.Geometry.NurbsSurface.CreateNetworkSurface(lns + [icrvs[i], icrvs[(i+1)%4]], 1, 0.1, 0.1, 0.1)[0]
        nsrfs.append(nsrf)


    lines = th.list_to_tree(lines)
    plines = th.list_to_tree(plines)
    pt_tmp = th.list_to_tree(pt_tmp)
    nsrfs = th.list_to_tree(nsrfs)
    pts = th.list_to_tree(Pts)



except Exception as e:
    print("--- An unexpected error occurred ---")
    print(e)
    print("--- Traceback ---")
    traceback.print_exc()
# ---------- end python_3_script ----------
panel = Panel(python_3_script.out)
surface = Surface(python_3_script.nsrfs)

# ---- group: curve
surface_2 = Surface(<surface referenced from the Rhino model>)
curve_2 = Curve([<curve referenced from the Rhino model> x10])
surface_3 = Surface(<surface referenced from the Rhino model>)
python_3_script_2 = Python3Script(
    surface_from=surface_3,
    surface_to=surface_2,
    curve_morph=curve_2,
    transpose=Toggle(True),
    reverse_x=Toggle(True),
    reverse_y=Toggle(False))  # -> out, curve_moved; inputs curve_morph: tree
# ---------- python_3_script_2: Python ----------
"""Grasshopper Script"""
import traceback
import Rhino
from Rhino.Geometry import NurbsSurface
import math
import os
import glob
import random

import rhinoscriptsyntax as rs
import ghpythonlib.treehelpers as th
import scriptcontext as sc

"""
靭帯生成
"""

sc.doc = Rhino.RhinoDoc.ActiveDoc

try:
    surface_from
    surface_to
    curve_morph
    transpose
    reverse_x
    reverse_y
except NameError:
    surface_from = None
    surface_to = None
    curve_morph = None
    transpose = False
    reverse_x = False
    reverse_y = False

try:
    # treeからリストへ
    curve_morph = th.tree_to_list(curve_morph)
    # surfaceがbrepの場合、surfaceに変換
    if type(surface_from) == Rhino.Geometry.Brep:
        surface_from = surface_from.Faces[0].ToNurbsSurface()
    if type(surface_to) == Rhino.Geometry.Brep:
        surface_to = surface_to.Faces[0].ToNurbsSurface()

    if transpose:
        surface_to = surface_to.Transpose()

    if reverse_x:
        surface_to = surface_to.Reverse(0, True)
    if reverse_y:
        surface_to = surface_to.Reverse(1, True)

    # 靭帯生成
    ssmorph = Rhino.Geometry.Morphs.SporphSpaceMorph(surface_from, surface_to)
    for crv in curve_morph:
        ssmorph.Morph(crv)

    curve_moved = curve_morph
    curve_moved = th.list_to_tree(curve_moved)

except Exception as e:
    print("--- An unexpected error occurred ---")
    print(e)
    print("--- Traceback ---")
    traceback.print_exc()
# ---------- end python_3_script_2 ----------
curve_3 = Curve(python_3_script_2.curve_moved)
pipe = Pipe(Curve=curve_3, Radius=Slider(1, range=0..5), Caps=2)

# ---- group: surface
surface_4 = Surface([<surface referenced from the Rhino model> x2])
python_3_script_3 = Python3Script(
    surface_from=surface_3,
    surface_to=surface_2,
    surface_morph=surface_4,
    thickness=Slider(1, range=0..3),
    transpose=Toggle(True),
    reverse_x=Toggle(False),
    reverse_y=Toggle(False))  # -> out, surface_moved, brep_moved; inputs surface_morph: tree
# ---------- python_3_script_3: Python ----------
"""Grasshopper Script"""
import traceback
import Rhino
from Rhino.Geometry import NurbsSurface
import math
import os
import glob
import random

import rhinoscriptsyntax as rs
import ghpythonlib.treehelpers as th
import scriptcontext as sc

"""
靭帯生成
"""

sc.doc = Rhino.RhinoDoc.ActiveDoc

try:
    surface_from
    surface_to
    surface_morph
    thickness
    transpose
    reverse_x
    reverse_y
except NameError:
    surface_from = None
    surface_to = None
    surface_morph = None
    thickness = None
    transpose = False
    reverse_x = False
    reverse_y = False

try:
    print("hello from vscode")
    # treeからリストへ
    surface_morph = th.tree_to_list(surface_morph)
    # surfaceがbrepの場合、surfaceに変換
    if type(surface_from) == Rhino.Geometry.Brep:
        surface_from = surface_from.Faces[0].ToNurbsSurface()
    if type(surface_to) == Rhino.Geometry.Brep:
        surface_to = surface_to.Faces[0].ToNurbsSurface()

    if transpose:
        surface_to = surface_to.Transpose()

    if reverse_x:
        surface_to = surface_to.Reverse(0, True)
    if reverse_y:
        surface_to = surface_to.Reverse(1, True)

    # 靭帯生成
    ssmorph = Rhino.Geometry.Morphs.SporphSpaceMorph(surface_from, surface_to)
    for crv in surface_morph:
        ssmorph.Morph(crv)

    print(type(surface_morph[0]))

    # 厚みをつける
    haveThickness_list = []
    for brp in surface_morph:
        brpface = brp.Faces[0]
        haveThickness = Rhino.Geometry.Brep.CreateFromOffsetFace(brpface, thickness, 0.01, True, True)
        haveThickness_list.append(haveThickness)
        

    surface_moved = surface_morph
    surface_moved = th.list_to_tree(surface_moved)
    brep_moved = th.list_to_tree(haveThickness_list)

except Exception as e:
    print("--- An unexpected error occurred ---")
    print(e)
    print("--- Traceback ---")
    traceback.print_exc()
# ---------- end python_3_script_3 ----------
panel_2 = Panel(python_3_script_3.out)
surface_5 = Surface(python_3_script_3.surface_moved)
geometry = Geometry(python_3_script_3.brep_moved)

# ---- group: ラティスパラメータ
X = Slider(4, range=0..20)
L = Slider(25, range=0..30)
Y = Slider(3, range=0..30)

# ---- group: 外形Brep
brep = Brep(<brep referenced from the Rhino model>)

# ---- group: index調整
list_item = ListItem(List=surface, Index=Slider(1, range=0..3), Wrap=True)  # -> Item, Item1, Item2, Item3
surface_6 = Surface(list_item.Item)
surface_7 = Surface(list_item.Item2)
surface_8 = Surface(list_item.Item3)
surface_9 = Surface(list_item.Item1)

# ----
surface_10 = Surface(reparameterize(surface_7))
surface_11 = Surface(reparameterize(surface_6))
surface_12 = Surface(reparameterize(surface_9))
surface_13 = Surface(reparameterize(surface_8))

# ---- group: 元のサーフェスから、UV原点と向きを合わせたサーフェスと、レールカーブを出力
python_3_script_4 = Python3Script(s0=surface_11, s1=surface_12, s2=surface_10, s3=surface_13)  # -> out, r0, r1, r2, r3, c0, c1, c2, c3; inputs s0: Brep, s1: Brep, s2: Brep, s3: Brep
# ---------- python_3_script_4: Python ----------
"""Grasshopper Script"""

import Rhino.Geometry as rg
import ghpythonlib.treehelpers as th
import rhinoscriptsyntax as rs

# srfs = th.tree_to_list(Surfaces)
# print(srfs)

srfs = [s0, s1, s2, s3]
print(srfs)
print("hello")

srfs_reversed = [s0.Faces[0].ToNurbsSurface()]

for i in range(1, len(srfs)):
    s_p = srfs[i-1]
    s_n = srfs[i]
    nb_p = s_p.Faces[0].ToNurbsSurface()
    nb_n = s_n.Faces[0].ToNurbsSurface()
    c0 = nb_p.PointAt(0, 1)
    p00 = nb_n.PointAt(0, 0)
    p10 = nb_n.PointAt(1, 0)
    p01 = nb_n.PointAt(0, 1)
    p11 = nb_n.PointAt(1, 1)
    p_list = [p00, p10, p01, p11]
    min_index = min(range(len(p_list)), key=lambda i: c0.DistanceTo(p_list[i]))
    print("i: ", i, "min_index: ", min_index)
    if min_index == 0:
        srfs_reversed.append(nb_n)
    elif min_index == 1:
        srfs_reversed.append(nb_n.Reverse(0))
    elif min_index == 2:
        srfs_reversed.append(nb_n.Reverse(1))
    else:
        srfs_reversed.append(nb_n.Reverse(0).Reverse(1))

    u_prev = nb_n.UVNDirectionsAt(0, 1)[1] # U direction
    u_next = nb_n.UVNDirectionsAt(0, 0)[1] # U direction
    v_next = nb_n.UVNDirectionsAt(0, 0)[2] # U direction
    u_direction_check = rg.Vector3d.Multiply(u_prev, u_next)
    v_direction_check = rg.Vector3d.Multiply(u_prev, v_next)
    if u_direction_check < v_direction_check:
        srfs_reversed[i] = srfs_reversed[i].Transpose()

r0 = srfs_reversed[0]
r1 = srfs_reversed[1]
r2 = srfs_reversed[2]
r3 = srfs_reversed[3]

# curve
curve_list = []
for i in range(len(srfs)):
    srf = srfs[i]
    nb = srf.Faces[0].ToNurbsSurface()
    crv = nb.IsoCurve(0, 0)
    # direction check
    pt_srf = nb.PointAt(0, 0)
    pt_crv = crv.PointAtStart
    pt_crv_end = crv.PointAtEnd
    dist = pt_srf.DistanceTo(pt_crv)
    dist_end = pt_srf.DistanceTo(pt_crv_end)
    if dist < dist_end:
        curve_list.append(crv)
    else:
        curve_list.append(crv.Reverse())

c0 = curve_list[0]
c1 = curve_list[1]
c2 = curve_list[2]
c3 = curve_list[3]
# ---------- end python_3_script_4 ----------

# ----
panel_3 = Panel(python_3_script_4.out)

# ---- group: Curve: 断面, レールの順
surface_14 = Surface(reparameterize(python_3_script_4.r1))
curve_4 = Curve(reparameterize(python_3_script_4.c1))

surface_15 = Surface(reparameterize(python_3_script_4.r3))
curve_5 = Curve(reparameterize(python_3_script_4.c3))

surface_16 = Surface(reparameterize(python_3_script_4.r2))
curve_6 = Curve(reparameterize(python_3_script_4.c2))

surface_17 = Surface(reparameterize(python_3_script_4.r0))
curve_7 = Curve(reparameterize(python_3_script_4.c0))

# ---- group: Surface UVチェック
srf = Surface(reparameterize([surface_17, surface_14, surface_16, surface_15]))
reverse_surface = ReverseSurface(Surface=srf, U=Toggle(False), V=False, W=Toggle(False), ShowArrows=True)
u = ColourSwatch(SwatchColor=RGB(2, 4, 255))
v = ColourSwatch(SwatchColor=RGB(225, 0, 0))
python = PythonScript(s=reverse_surface, swapUV=Toggle(False), reverseU=Toggle(False), reverseV=Toggle(False))  # -> out, anchor, uVec, vVec, revSrf; inputs s: Surface, swapUV: Int32, reverseU: Int32, reverseV: Int32
# ---------- python: Python ----------
import Rhino

if reverseU:
    uS,uE = s.Domain(0)
    inter0 = Rhino.Geometry.Interval(-uE, -uS)
    s.SetDomain(0,inter0)
    s = s.Reverse(0)

if reverseV:
    vS,vE = s.Domain(1)
    inter1 = Rhino.Geometry.Interval(-vE, -vS)
    s.SetDomain(1,inter1)
    s = s.Reverse(1)

if swapUV:
    s = s.Transpose()

anchor = s.PointAt(0,0)
uend = s.PointAt(0.5,0)
vend = s.PointAt(0,0.5)
uVec = uend - anchor
vVec = vend - anchor

revSrf = s
# ---------- end python ----------
vdisex = VectorDisplayEx(Point=python.anchor, Vector=python.uVec, Colour=u, Width=3)
vdisex_2 = VectorDisplayEx(Point=python.anchor, Vector=python.vVec, Colour=v, Width=3)

# ----
multiplication = Multiplication(A=L, B=2)

# ---- group: Rails
curve_8 = Curve([curve_7, curve_4, curve_6, curve_5])

# ---- group: レール分割
range = Range(Domain=Domain(0, 1), Steps=multiplication)
graph_mapper = GraphMapper(
    range,
    x0=0,
    x1=1,
    y0=0,
    y1=1,
    container_name="Bezier",
    cpx=[0, 0.4667526484, 0.5173021555, 1],
    cpy=[0, 0.4459422827, 0.4901724458, 1])
evaluate_length = EvaluateLength(Curve=graft([curve_7, curve_4, curve_6, curve_5]), Length=graph_mapper, Normalized=True)  # -> Point, Tangent, Parameter
panel_4 = Panel(evaluate_length.Point)
param_viewer = ParamViewer(evaluate_length.Point)

# ----
path_mapper = PathMapper(curve_8, source="{A}", target="{0;A}")
param_viewer_2 = ParamViewer(path_mapper)

# ---- group: サーフェス上の断面エッジ / Surfaces
surface_18 = Surface([surface_17, surface_14, surface_16, surface_15])

# ----
panel_5 = Panel(surface_18)

# ---- group: サーフェス上の断面エッジ
surface_closest_point = SurfaceClosestPoint(Point=evaluate_length.Point, Surface=graft(surface_18))  # -> Point, UVPoint, Distance
panel_6 = Panel(surface_closest_point.UVPoint)
iso_curve = IsoCurve(Surface=graft(surface_18), UVPoint=surface_closest_point.UVPoint)  # -> UIsocurve, VIsocurve
param_viewer_3 = ParamViewer(surface_closest_point.UVPoint)
curve_9 = Curve(iso_curve.VIsocurve)

# ----
curve_10 = Curve(path_mapper)

# ---- group: 断面のUVを整列 / Rails
curve_11 = Curve(reparameterize(curve_10))

# ---- group: 外形Brep
brep_2 = Brep(brep)

# ---- group: 外側サーフェス・外側カーブ作成 / 筋形状Brep
brep_3 = Brep(brep_2)

# ---- group: 旧型のワイヤ経路作成 / 厚み
number_slider = Slider(2, range=0..3)

# ---- group: 旧型のワイヤ経路作成 / ワイヤカーブ
curve_12 = Curve(<curve referenced from the Rhino model>)

# ---- group: 旧型のワイヤ経路作成 / 筋外形サーフェス（パイプカットなし）
brep_4 = Brep(<brep referenced from the Rhino model>)

# ---- group: 断面
path_mapper_2 = PathMapper(curve_9, source="{A;B;C}(i)", target="{0;A;B}")
panel_7 = Panel(path_mapper_2)
param_viewer_4 = ParamViewer(path_mapper_2)

split_tree = SplitTree(Data=path_mapper_2, Masks=flatten("{*;0}"))  # -> Positive, Negative

split_tree_2 = SplitTree(Data=path_mapper_2, Masks=flatten("{*;1}"))  # -> Positive, Negative

split_tree_3 = SplitTree(Data=path_mapper_2, Masks=flatten("{*;3}"))  # -> Positive, Negative

split_tree_4 = SplitTree(Data=path_mapper_2, Masks=flatten("{*;2}"))  # -> Positive, Negative

edge_surface = EdgeSurface(CurveA=split_tree.Positive, CurveB=split_tree_2.Positive, CurveC=split_tree_4.Positive, CurveD=split_tree_3.Positive)

# ----
panel_8 = Panel(edge_surface)

# ---- group: 断面のUVを整列
surface_19 = Surface(reparameterize(edge_surface))

# ---- group: 断面のUVを整列 / 断面Surfaceとレールから、断面UVを整列
python_3_script_5 = Python3Script(Surfaces=surface_19, Rails=curve_11)  # -> out, curve_origin, nb_adjust; inputs Surfaces: tree of Brep, Rails: list of Curve
# ---------- python_3_script_5: Python ----------
"""Grasshopper Script"""
import Rhino.Geometry as rg
import ghpythonlib.treehelpers as th
import rhinoscriptsyntax as rs

# measure distance between point and curve
def distance_PC (pt, crv):
    cp_t = crv.ClosestPoint(pt)[1] 
    cp_pt = crv.PointAt(cp_t)
    # print(cp_pt)
    # print(pt.DistanceTo(cp_pt))
    # return cp_pt
    return pt.DistanceTo(cp_pt)
    

srfs = th.tree_to_list(Surfaces) # brep tree

s0 = srfs[0][0][0]
print(s0)
print(Rails[0])

# first surface
nb0 = s0.Faces[0].ToNurbsSurface()
s0_origin = nb0.PointAt(0, 0)
print("s0_origin", type(s0_origin))
a = s0_origin

c = Rails[0].PointAt(0.5)

curve_origin = min(Rails, key=lambda curve : distance_PC(s0_origin, curve))

# adjust uv origin
nb_adjust = [nb0]
for i in range(1, len(srfs[0][0])):
    srf = srfs[0][0][i]
    nb = srf.Faces[0].ToNurbsSurface()
    p00 = nb.PointAt(0, 0)
    p10 = nb.PointAt(1, 0)
    p01 = nb.PointAt(0, 1)
    p11 = nb.PointAt(1, 1)
    p_list = [p00, p10, p01, p11]
    min_index = min(range(len(p_list)), key=lambda i: distance_PC(p_list[i], curve_origin))
    print("surface ", i, ": direction ", min_index)
    if min_index == 0:
        nb_adjust.append(nb)
    elif min_index == 1:
        nb_adjust.append(nb.Reverse(0))
    elif min_index == 2:
        nb_adjust.append(nb.Reverse(1))
    else:
        nb_adjust.append(nb.Reverse(0).Reverse(1))


# nb_adjust = th.list_to_tree(nb_adjust)

# get tangent
derivative = curve_origin.DerivativeAt(0.5, 1)
print(derivative[0])
print(derivative[1])

for i in range(len(nb_adjust)):
    nb = nb_adjust[i]
    p0 = nb.PointAt(0, 0)
    cp_t = curve_origin.ClosestPoint(p0)[1]
    derivative = curve_origin.DerivativeAt(cp_t, 1)
    print(derivative[1]) # tangent
    # u and v derivative
    du = nb.UVNDirectionsAt(0, 0)
    w = rg.Vector3d.CrossProduct(du[1], du[2])
    direction_check = rg.Vector3d.Multiply(derivative[1], du[3])
    print("check: ", direction_check)
    if direction_check > 0:
        nb_adjust[i] = nb.Transpose()
# ---------- end python_3_script_5 ----------

# ---- group: 断面のUV方向辺を取得
brep_edges = BrepEdges(Brep=python_3_script_5.nb_adjust)  # -> Naked, Interior, NonManifold
curve_13 = Curve(brep_edges.Naked)
python_3_script_6 = Python3Script(Curves=curve_13, Surfaces=surface_18)  # -> out, cs_num, Curves_sorted; inputs Curves: tree of Curve, Surfaces: list of Brep
# ---------- python_3_script_6: Python ----------
"""Grasshopper Script"""

import Rhino.Geometry as rg
import ghpythonlib.treehelpers as th

crvs = th.tree_to_list(Curves)

cs_num = len(crvs[0])

Curves_sorted = []

for i in range(cs_num):
    distances = []
    mps = []
    for j in range(4):
        crv = crvs[0][i][j]
        t0 = crv.Domain.Min
        t1 = crv.Domain.Max
        t_mid = (t0 + t1) / 2
        mid_point = crv.PointAt(t_mid)
        mps.append(mid_point)

    # sort
    cvs_s = []
    for k, srf in enumerate(Surfaces):
        cpt, cpt_idx = min((srf.ClosestPoint(pt).DistanceTo(pt), i_) for i_, pt in enumerate(mps))
        # print(i, cpt_idx)
        cvs_s.append(crvs[0][i][cpt_idx])

    Curves_sorted.append(cvs_s)

Curves_sorted = th.list_to_tree([Curves_sorted])
# ---------- end python_3_script_6 ----------
list_item_2 = ListItem(List=python_3_script_6.Curves_sorted, Index=0, Wrap=True)  # -> Item, Item1
curve_14 = Curve(list_item_2.Item)
curve_15 = Curve(list_item_2.Item1)

# ---- group: 断面のUVを整列 (continued)
panel_9 = Panel(python_3_script_5.nb_adjust)

# ---- group: Surface UVチェック
srf_2 = Surface(reparameterize(python_3_script_5.nb_adjust))
reverse_surface_2 = ReverseSurface(Surface=srf_2, U=Toggle(False), V=False, W=Toggle(True), ShowArrows=True)
u_2 = ColourSwatch(SwatchColor=RGB(2, 4, 255))
v_2 = ColourSwatch(SwatchColor=RGB(225, 0, 0))
python_2 = PythonScript(s=reverse_surface_2, swapUV=Toggle(False), reverseU=Toggle(False), reverseV=Toggle(False))  # -> out, anchor, uVec, vVec, revSrf; inputs s: Surface, swapUV: Int32, reverseU: Int32, reverseV: Int32; same code as python
vdisex_3 = VectorDisplayEx(Point=python_2.anchor, Vector=python_2.uVec, Colour=u_2, Width=3)
vdisex_4 = VectorDisplayEx(Point=python_2.anchor, Vector=python_2.vVec, Colour=v_2, Width=3)

# ----
panel_10 = Panel(curve_13)

# ---- group: U方向のIso Curveを作成
multiplication_2 = Multiplication(A=X, B=2)
path_mapper_3 = PathMapper(python_3_script_5.nb_adjust, source="{A;B}", target="{0;A;B}")
range_2 = Range(Domain=Domain(0, 1), Steps=multiplication_2)
evaluate_length_2 = EvaluateLength(Curve=curve_14, Length=range_2, Normalized=True)  # -> Point, Tangent, Parameter
param_viewer_5 = ParamViewer(evaluate_length_2.Point)
panel_11 = Panel(evaluate_length_2.Point)

# ---- group: U方向のIso Curveを作成 / Cross section surfaces
surface_20 = Surface(path_mapper_3)

# ---- group: U方向のIso Curveを作成 (continued)
path_mapper_4 = PathMapper(surface_20, source="{A;B;C}(i)", target="{A;B;i}")
param_viewer_6 = ParamViewer(surface_20)
surface_closest_point_2 = SurfaceClosestPoint(Point=evaluate_length_2.Point, Surface=path_mapper_4)  # -> Point, UVPoint, Distance
iso_curve_2 = IsoCurve(Surface=path_mapper_4, UVPoint=surface_closest_point_2.UVPoint)  # -> UIsocurve, VIsocurve
panel_12 = Panel(surface_closest_point_2.UVPoint)

# ---- group: U方向のIso Curveを作成 / この部分で2択が生じているのが良くない。
curve_16 = Curve(iso_curve_2.UIsocurve)
curve_17 = Curve(iso_curve_2.VIsocurve)

# ---- group: 断面上のカーブについて、V方向に分割
multiplication_3 = Multiplication(A=Y, B=2)
range_3 = Range(Domain=Domain(0, 1), Steps=multiplication_3)
evaluate_length_3 = EvaluateLength(Curve=curve_16, Length=range_3, Normalized=True)  # -> Point, Tangent, Parameter

# ---- group: U方向のIso Curveを作成 (continued)
panel_13 = Panel(curve_16)

# ---- group: 断面上のカーブについて、V方向に分割 / ツリーの根本から順に、断面深さ方向と、断面上のUV(UV方向は逆かも？
point = Point(evaluate_length_3.Point)

# ---- group: 外側サーフェス・外側カーブ作成
python_3_script_7 = Python3Script(points=point, UV=Toggle(False))  # -> out, srfs0, srfs1; inputs points: tree
# ---------- python_3_script_7: Python ----------
"""Grasshopper Script"""

import traceback
import Rhino
from Rhino.Geometry import NurbsSurface
import math
import os
import glob
import random

import Rhino.Geometry

import rhinoscriptsyntax as rs
import ghpythonlib.treehelpers as th
import scriptcontext as sc

sc.doc = Rhino.RhinoDoc.ActiveDoc

try:
    points
    UV
except NameError:
    points = None
    UV = True

try:
    points = th.tree_to_list(points)[0]
    print(len(points))
    print(len(points[0]))
    print(len(points[0][0]))
    if UV:
        # 2,3次元目を交換する
        points = [[point for point in zip(*points[i])] for i in range(len(points))]

    # keyはi+j, valueは点のリストのリスト
    # valueは2次元グリッドを構成する
    diag_dict0 = {} 
    diag_dict1 = {} 
    # 斜めのgridを作成する
    for i in range(len(points)):
        if i%2 == 1:
            continue
        for j in range(len(points[0])):
            if j%2 == 1:
                continue
            # i+jが同じグループで分ける
            ky0 = i+j
            if ky0 not in diag_dict0:
                diag_dict0[ky0] = []
            diag_dict0[ky0].append(points[i][j])
            ky1 = i-j
            if ky1 not in diag_dict1:
                diag_dict1[ky1] = []
            diag_dict1[ky1].append(points[i][j])

    # diag_dictのvalueについて、それぞれからサーフェスを作成する
    srfs0 = []
    for key in diag_dict0:
        diag = diag_dict0[key]
        if len(diag) < 2:
            continue
        uCount = len(diag)
        vCount = len(diag[0])
        # diagを1次元配列にする
        pts = [pt for diag in diag for pt in diag]
        print(len(pts))
        srf = Rhino.Geometry.NurbsSurface.CreateThroughPoints(pts, uCount, vCount, 3, 3, False, False)
        srfs0.append(srf)

    srfs1 = []
    for key in diag_dict1:
        diag = diag_dict1[key]
        if len(diag) < 2:
            continue
        uCount = len(diag)
        vCount = len(diag[0])
        # diagを1次元配列にする
        pts = [pt for diag in diag for pt in diag]
        print(len(pts))
        srf = Rhino.Geometry.NurbsSurface.CreateThroughPoints(pts, uCount, vCount, 3, 3, False, False)
        srfs1.append(srf)

    srfs0 = th.list_to_tree(srfs0)
    srfs1 = th.list_to_tree(srfs1)


except Exception as e:
    print("--- An unexpected error occurred ---")
    print(e)
    print("--- Traceback ---")
    traceback.print_exc()
# ---------- end python_3_script_7 ----------
surface_21 = Surface(python_3_script_7.srfs1)
surface_22 = Surface(python_3_script_7.srfs0)
surface_23 = Surface(flatten([surface_22, surface_21]))

# ---- group: 旧型のワイヤ経路作成
pipe_interior_diameter = Slider(6, range=0..10)
pipe_exterior_diameter = Slider(12, range=0..15)
surface_24 = Surface(reparameterize(flatten(surface_23)))
python_3_script_8 = Python3Script(
    srfs=surface_24,
    offset=number_slider,
    wires=curve_12,
    d0=pipe_interior_diameter,
    d1=pipe_exterior_diameter,
    shape=brep_4)  # -> out, a, b, c, d; inputs srfs: tree of Brep, wires: tree
# ---------- python_3_script_8: Python ----------
"""Grasshopper Script"""
import traceback
import Rhino
from Rhino.Geometry import NurbsSurface
import math
import os
import glob
import random

import Rhino.Geometry

import rhinoscriptsyntax as rs
import ghpythonlib.treehelpers as th
import scriptcontext as sc

sc.doc = Rhino.RhinoDoc.ActiveDoc

try:
    srfs # brep
    offset # offset distance
    wires # wire curve
    d0 # pipe internal diameter
    d1 # pipe external diameter
    shape # muscle external shape
except NameError:
    srfs = None
    offset = None
    wires = None
    d0 = None
    d1 = None
    shape = None

try:
    print("hello from vscode")
    srfs = th.tree_to_list(srfs)
    wires = th.tree_to_list(wires)
    print(len(srfs)) # list

    offset_dist = offset / 2

    offset_out = []

    # 斜め曲面のオフセットによる板状ソリッドを作成
    for srf in srfs:
        face = srf.Faces[0]
        offset_tmp = Rhino.Geometry.Brep.CreateFromOffsetFace(face, 
            offset_dist, 
            sc.doc.ModelAbsoluteTolerance, 
            True, 
            True)
        offset_out.append(offset_tmp)

    pipe_out = []
    
    # パイプを作成
    for wire in wires:
        pipe_brep = Rhino.Geometry.Brep.CreateThickPipe(wire, d0/2, d1/2, 
            True,
            Rhino.Geometry.PipeCapMode.Flat,
            True,
            sc.doc.ModelAbsoluteTolerance,
            sc.doc.ModelAngleToleranceRadians)

        pipe_out.append(pipe_brep[0])

    # ブーリアン
    intersection = Rhino.Geometry.Brep.CreateBooleanIntersection(offset_out, 
        pipe_out,
        sc.doc.ModelAbsoluteTolerance,
        True)

    # 筋肉形状に合わせてカット
    diff = Rhino.Geometry.Brep.CreateBooleanIntersection(intersection,
        [shape], 
        sc.doc.ModelAbsoluteTolerance,
        True)

        
    a = th.list_to_tree(offset_out)
    b = th.list_to_tree(pipe_out)
    c = th.list_to_tree(intersection)
    d = th.list_to_tree(diff)

except Exception as e:
    print("--- An unexpected error occurred ---")
    print(e)
    print("--- Traceback ---")
    traceback.print_exc()
# ---------- end python_3_script_8 ----------
panel_14 = Panel(python_3_script_8.out)

# ---- group: Explodeなしの場合
brep_brep = BrepBrep(BrepA=brep_3, BrepB=surface_23)  # -> Curves, Points
rebuild_curve = RebuildCurve(Curve=brep_brep.Curves, Count=Slider(100, range=0..100), Tangents=False)

# ---- group: Explodeなしの場合 / パイプ作成へ
curve_18 = Curve(rebuild_curve)

# ---- group: 点のグループ化、各点の太さの計算 / ラティス構成カーブごとに点をグループ化
python_3_script_9 = Python3Script(Points=point)  # -> out, g0, g1, g2, g3, c0, c1, c2, c3; inputs Points: tree
# ---------- python_3_script_9: Python ----------
"""Grasshopper Script"""

import Rhino.Geometry as rg
import ghpythonlib.treehelpers as th
import rhinoscriptsyntax as rs

pts = th.tree_to_list(Points)[0]
print(len(pts), len(pts[0]), len(pts[0][0]))

A = len(pts)
B = len(pts[0])
C = len(pts[0][0])

dict0 = {}
dict1 = {}
dict2 = {}
dicts = [{}, {}, {}, {}]
c_dicts = [{}, {}, {}, {}] # dict for cross section number

for i in range(A):
    for j in range(B):
        for k in range(C):
            pt = pts[i][j][k]
            xpy = i + j
            xpz = i + k
            xmy = i - j
            xmz = i - k
            if xpy%2 != 0 or xpz%2 != 0:
                continue
            keys = [(xpy, xpz), (xpy, xmz), (xmy, xpz), (xmy, xmz)]
            for l in range(len(dicts)):
                ky = keys[l]
                dct = dicts[l]
                c_dct = c_dicts[l]
                if not ky in dct:
                    dct[ky] = []
                    c_dct[ky] = []
                dct[ky].append(pt)
                c_dct[ky].append(i)

# delete one pt 
for i in range(len(dicts)):
    keys_to_remove = [key for key, value in dicts[i].items() if len(value) == 1]
    for key in keys_to_remove:
        del dicts[i][key]
        del c_dicts[i][key]

list0 = list(dicts[0].values())
g0 = th.list_to_tree(list0)

list1 = list(dicts[1].values())
g1 = th.list_to_tree(list1)

list2 = list(dicts[2].values())
g2 = th.list_to_tree(list2)

list3 = list(dicts[3].values())
g3 = th.list_to_tree(list3)

c0 = th.list_to_tree(list(c_dicts[0].values()))
c1 = th.list_to_tree(list(c_dicts[1].values()))
c2 = th.list_to_tree(list(c_dicts[2].values()))
c3 = th.list_to_tree(list(c_dicts[3].values()))
# ---------- end python_3_script_9 ----------

# ---- group: 点のグループ化、各点の太さの計算
param_viewer_7 = ParamViewer(python_3_script_9.g0)
panel_15 = Panel(python_3_script_9.c0)
param_viewer_8 = ParamViewer(point)
interpolate = Interpolate(Vertices=python_3_script_9.g0, Degree=3, Periodic=False, KnotStyle=1)  # -> Curve, Length, Domain
interpolate_2 = Interpolate(Vertices=python_3_script_9.g1, Degree=3, Periodic=False, KnotStyle=1)  # -> Curve, Length, Domain
interpolate_3 = Interpolate(Vertices=python_3_script_9.g2, Degree=3, Periodic=False, KnotStyle=1)  # -> Curve, Length, Domain
interpolate_4 = Interpolate(Vertices=python_3_script_9.g3, Degree=3, Periodic=False, KnotStyle=1)  # -> Curve, Length, Domain
curve_19 = Curve(reparameterize(interpolate.Curve))
curve_20 = Curve(reparameterize(interpolate_2.Curve))
curve_21 = Curve(reparameterize(interpolate_3.Curve))
panel_16 = Panel(point)
curve_22 = Curve(reparameterize(interpolate_4.Curve))

# ---- group: 旧型のワイヤ経路作成 / ワイヤ経路出力
brep_5 = Brep(python_3_script_8.d)

# ---- group: ラティスカーブ
curve_23 = Curve([curve_19, curve_20, curve_21, curve_22])
trim_with_brep = TrimWithBrep(Curve=curve_23, Brep=brep_2)  # -> Inside, Outside
curve_24 = Curve(flatten(curve_18))
curve_25 = Curve(trim_with_brep.Inside)

# ---- group: multipipeの場合
curve_26 = Curve(simplify(flatten([curve_25, curve_24])))
multipipe = MultiPipe(
    Curves=curve_26,
    NodeSize=Slider(1, range=0..10),
    EndOffset=Slider(0, range=0..100),
    StrutSize=1,
    Segment=0,
    KinkAngle=Slider(0.1, range=0..1),
    CubeFit=0,
    Caps=1)
